# Grasshopper definition testcase.gh (Grasshopper 1.0.7)
# plug-ins: GHEmbree

number_slider = Slider(10, range=10..100)
number_slider_2 = Slider(25, range=10..30)
number_slider_3 = Slider(100, range=100..1000)
domain = Domain(Domain(0, 1))
number_slider_4 = Slider(102, range=10..1000)
pt = ConstructPoint(XCoordinate=0, YCoordinate=0, ZCoordinate=0)
rectangle = Rectangle(Plane=PlaneXY(0, 0, 0), XSize=domain, YSize=domain, Radius=0)  # -> Rectangle, Length
msphere = MeshSphere(Base=PlaneXY(0, 0, 0), Radius=1, UCount=number_slider_2, VCount=number_slider_2)
pt_2 = ConstructPoint(
    XCoordinate=expr("x/2", number_slider_3),
    YCoordinate=expr("x/2", number_slider_3),
    ZCoordinate=expr("x*2", number_slider))
demesh = DeconstructMesh(Mesh=msphere)  # -> Vertices, Faces, Colours, Normals
arrrec = RectangularArray(Geometry=pt, Cell=rectangle.Rectangle, XCount=number_slider_3, YCount=number_slider_3)  # -> Geometry, Transform
msphere_2 = MeshSphere(Base=pt_2, Radius=number_slider, UCount=number_slider_4, VCount=number_slider_4)
devec = DeconstructVector(Vector=demesh.Vertices)  # -> XComponent, YComponent, ZComponent
smaller = SmallerThan(FirstNumber=devec.ZComponent, SecondNumber=0)  # -> SmallerThan, OrEqualTo
cull = CullPattern(List=demesh.Vertices, CullPattern=smaller.SmallerThan)
occ = Occlusion(Samples=arrrec.Geometry, Obstructions=msphere_2, Rays=cull)  # -> Hits, Occlusion
emocc = EmbreeOcclusion(Samples=arrrec.Geometry, Obstructions=msphere_2, Rays=cull)  # -> Hits, Occlusions
python = GhPythonScript(A=occ.Hits, B=emocc.Hits)  # -> out, eq; inputs A: list, B: list
# ---------- python: Python ----------
__author__ = "DGWGSE"
__version__ = "2020.11.11"

import rhinoscriptsyntax as rs

eq = True
for a,b in zip(A,B):
    if not a == b:
        eq =False
    break
# ---------- end python ----------
bnd = Bounds(Numbers=occ.Hits)
panel = Panel(python.eq)
